# Grasshopper definition disambiguation demo.gh (Grasshopper 1.0.7)
# plug-ins: Firefly.Core, KTTools

crv = Curve(<curve referenced from the Rhino model>)
number_slider = Slider(82, range=0..100)
eval = EvaluateCurve(Curve=crv, Parameter=number_slider)  # -> Point, Tangent, Angle
target = Point(eval.Point)
array_path = Curve(<curve referenced from the Rhino model>)

# ---- group: Target Randomize
cir = Circle(Plane=target, Radius=8)
random = Random(Range=Domain(0, 100), Number=100, Seed=2)
eval_2 = EvaluateCurve(Curve=cir, Parameter=random)  # -> Point, Tangent, Angle
item = ListItem(List=eval_2.Point, Index=number_slider, Wrap=True)

# ----
north_vector = Vector(Vector(0, 60.18328424, 0))
target_2 = Point(item)
eval_3 = EvaluateCurve(Curve=array_path, Parameter=number_slider)  # -> Point, Tangent, Angle
ln = Line(StartPoint=eval_3.Point, EndPoint=target_2)

# ---- group: Display Array Heading
amp = Amplitude(Vector=eval_3.Tangent, Amplitude=5)
vdisex = VectorDisplayEx(Point=eval_3.Point, Vector=amp, Colour=RGB(0, 0, 0), Width=4)

# ---- group: Mirror Plane about heading
pl = ConstructPlane(Origin=eval_3.Point, XAxis=eval_3.Tangent, YAxis=Vector(0, 0, -24.56147635))
mirror = Mirror(Geometry=ln, Plane=pl)  # -> Geometry, Transform
deplane = DeconstructPlane(Plane=pl)  # -> Origin, XAxis, YAxis, ZAxis

# ---- group: Construct North Vectors for display
pl_2 = ConstructPlane(Origin=eval_3.Point, XAxis=Vector(1, 0, 0), YAxis=Vector(0, 1, 0))
line = LineSDL(Start=pl_2, Direction=Vector(0, 1, 0), Length=50)
end = EndPoints(Curve=line)  # -> Start, End
end_2 = EndPoints(Curve=mirror.Geometry)  # -> Start, End

# ---- group: Angle Calculations
ambig_angle = Angle(VectorA=mirror.Geometry, VectorB=north_vector)  # -> Angle, Reflex
real_angle = Angle(VectorA=ln, VectorB=north_vector)  # -> Angle, Reflex
hdt = Angle(VectorA=deplane.XAxis, VectorB=north_vector)  # -> Angle, Reflex

# ---- group: Angle Dimensions
angledim = AngularDimension(Center=eval_3.Point, PointA=end.End, PointB=target_2, Reflex=False, Text="{0:0.0}°", Size=2)
angledim_2 = AngularDimension(Center=eval_3.Point, PointA=end.End, PointB=end_2.End, Reflex=False, Text="{0:0.0}°", Size=2)
tag = TextTag3D(Location=end.End, Text="North", Size=3, Justification=8)

# ----
end_3 = EndPoints(Curve=mirror.Geometry)  # -> Start, End
panel = Panel(real_angle.Angle)

# ---- group: Buffer Depth Decider based on movement
buffer = Buffer(Number=hdt.Angle, BufferDomain=Domain(0, 50))  # -> BufferValues, BufferMinimum, BufferMaximum
st = Statistics(Values=buffer.BufferValues)  # -> Average, StandardDeviation
remap = RemapNumbers(Value=st.StandardDeviation, Source=Domain(1, 0), Target=Domain(5, 20))  # -> Mapped, Clipped
round = Round(Number=remap.Clipped)  # -> Nearest, Floor, Ceiling
panel_2 = Panel(round.Nearest)

# ---- group: Real/Ambig Buffer and Stats
buffer_2 = Buffer(Number=real_angle.Angle, BufferDomain=round.Nearest)  # -> BufferValues, BufferMinimum, BufferMaximum
buffer_3 = Buffer(Number=ambig_angle.Angle, BufferDomain=round.Nearest)  # -> BufferValues, BufferMinimum, BufferMaximum
st_2 = Statistics(Values=buffer_3.BufferValues)  # -> Average, StandardDeviation
st_3 = Statistics(Values=buffer_2.BufferValues)  # -> Average, StandardDeviation

# ---- group: Vector Display
vec2pt = Vector2Pt(PointA=deplane.Origin, PointB=target_2, Unitize=False)  # -> Vector, Length
vec2pt_2 = Vector2Pt(PointA=deplane.Origin, PointB=end_3.End, Unitize=False)  # -> Vector, Length
amp_2 = Amplitude(Vector=vec2pt_2.Vector, Amplitude=expr("x*100", st_3.StandardDeviation))
amp_3 = Amplitude(Vector=vec2pt.Vector, Amplitude=expr("x*100", st_2.StandardDeviation))
vdisex_2 = VectorDisplayEx(Point=deplane.Origin, Vector=amp_3, Colour=RGB(235, 30, 30), Width=10)
vdisex_3 = VectorDisplayEx(Point=deplane.Origin, Vector=amp_2, Colour=RGB(50, 250, 0), Width=10)

# ----
panel_3 = Panel(st_3.StandardDeviation)
panel_4 = Panel(st_2.StandardDeviation)
